# Grasshopper definition 05 RFCOM - Loads.gh (Grasshopper 1.0.7)
# plug-ins: daqRFEM

# ----
# B+G Team: B+G Ingenieure Bollinger und Grohmann GmbH
# Alt-Moabit 103  / D-10559 Berlin  / Tel. +49 30 - 41 95 369 0  / Fax +49 30 - 41 95 369 99
# Diego Apellániz
# dapellaniz@bollinger-grohmann.de
# Description: The process of defining load data and load cases for an RFEM Modell inside Grasshopper is explained.
# 
# Some key aspects to take into account:
# 
# - It is possible to define model data, load data and load cases and combos within the same Set Data Component.  The export process to RFEM is faster this way since the connection between GH and RFEM is required only once.
# 
# - It can be very efficient to define theLive Load with chessboard distribution in Grasshopper.
grasshopper_version = Panel("1.0.0007")
# Plugin Description: This Plug-In enables an interoperability between RFEM and Grasshopper through the RFCOM API.
# 
# It allows the user to import data from RFEM into Grasshopper and also to define new model data through the Grasshopper interface.
plugin = Panel("RFEM")
related_rfem_file_s = Panel("05 RFCOM - Loads.rf5")

# ---- group: Geometry
opening_crv = Curve(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)
grid_pt = Point([Point(0, 0, 0), Point(0, 8, 0), Point(8, 8, 0), Point(16, 8, 0), Point(0, 16, 0), Point(8, 16, 0), Point(16, 16, 0), Point(24, 16, 0), Point(32, 16, 0), Point(40, 44, 0)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])
contour_crv = Curve(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)
core_crv = Curve(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)

# ----
crv_cp = CurveClosestPoint(Point=grid_pt, Curve=core_crv)  # -> Point, Parameter, Distance
cull = CullPattern(List=grid_pt, CullPattern=crv_cp.Distance)
Z = UnitZ(Factor=1)
line = LineSDL(Start=cull, Direction=Z, Length="-3.5")
amp = Amplitude(Vector=Z, Amplitude="-3.5")
extr = Extrude(Base=core_crv, Direction=amp)
boundary = BoundarySurfaces(Edges=[contour_crv, opening_crv])
move = Move(Geometry=core_crv, Motion=amp)  # -> Geometry, Transform
debrep = DeconstructBrep(Brep=extr)  # -> Faces, Edges, Vertices
explode = Explode(Curve=move.Geometry, Recursive=True)  # -> Segments, Vertices
explode_2 = Explode(Curve=opening_crv, Recursive=True)  # -> Segments, Vertices
panel = Panel("""2
3
4
5""")
end = EndPoints(Curve=line)  # -> Start, End
rfsurface = RFSurface(Surface=boundary, SurfaceNumber="1", MaterialNumber="1", Thickness_m="0.3", Comment="Slab", mode="Assemble")
rfmember = RFMember(Line=line, StartCrossSection="2", Comment="Columns", mode="Assemble")
rfsurface_2 = RFSurface(Surface=debrep.Faces, SurfaceNumber=panel, MaterialNumber="2", Thickness_m="0.3", Comment="Core Walls", mode="Assemble")
rfnodalsupport = RFNodalSupport(Location=end.End, DisplacementDirX="-1", DisplacementDirY="-1", DisplacementDirZ="-1", mode="Assemble")
rflinesupport = RFLineSupport(Line=explode.Segments, DisplacementDirX="-1", DisplacementDirY="-1", DisplacementDirZ="-1", mode="Assemble")

# ---- group: Load Cases
list = ValueList({"UnknownActionCategory": 0, "Permanent": 1, "Prestress": 2, "Imposed": 3, "TrafficLoads": 4, "SnowIce": 5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}, selected="DeadLoad": 16)
list_2 = ValueList({"UnknownActionCategory": 0, "Permanent": 1, "Prestress": 2, "Imposed": 3, "TrafficLoads": 4, "SnowIce": 5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}, selected="ImposedCategoryA": 25)
list_3 = ValueList({"UnknownActionCategory": 0, "Permanent": 1, "Prestress": 2, "Imposed": 3, "TrafficLoads": 4, "SnowIce": 5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}, selected="PermanentImposed": 20)
list_4 = ValueList({"UnknownActionCategory": 0, "Permanent": 1, "Prestress": 2, "Imposed": 3, "TrafficLoads": 4, "SnowIce": 5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}, selected="PermanentImposed": 20)
list_5 = ValueList({"UnknownActionCategory": 0, "Permanent": 1, "Prestress": 2, "Imposed": 3, "TrafficLoads": 4, "SnowIce": 5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}, selected="ImposedCategoryA": 25)
list_6 = ValueList({"UnknownActionCategory": 0, "Permanent": 1, "Prestress": 2, "Imposed": 3, "TrafficLoads": 4, "SnowIce": 5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}, selected="ImposedCategoryE": 29)
Z_2 = UnitZ(Factor="-1")
rfloadcase = RFLoadCase(LoadCaseNumber="1", Description="Self Weight", ActionCategory=list, SelfWeightFactor=Z_2, mode="Assemble")
rfloadcase_2 = RFLoadCase(LoadCaseNumber="4", Description="Live Load 1", ActionCategory=list_2, mode="Assemble")
rfloadcase_3 = RFLoadCase(LoadCaseNumber="2", Description="SDL", ActionCategory=list_3, mode="Assemble")
rfloadcase_4 = RFLoadCase(LoadCaseNumber="3", Description="Facade", ActionCategory=list_4, mode="Assemble")
rfloadcase_5 = RFLoadCase(LoadCaseNumber="5", Description="Live Load 2", ActionCategory=list_5, mode="Assemble")
rfloadcase_6 = RFLoadCase(LoadCaseNumber="6", Description="Live Load 3", ActionCategory=list_6, mode="Assemble")
merge = Merge(Data1=rfloadcase, Data2=rfloadcase_3, Data3=rfloadcase_4, Data4=rfloadcase_2, Data5=rfloadcase_5, Data6=rfloadcase_6)

# ---- group: Loads / Load Sectors
# It can be very efficient to
# define theLive Load with
# chessboard distribution
# in Grasshopper.
cluster = Cluster(P=grid_pt)

# ----
rfmember_2 = RFMember(Line=explode_2.Segments, StartCrossSection="1", Comment="Beams", Eccentricity="1", mode="Assemble")

# ---- group: Loads
srf = Surface(cluster)
area = Area(Geometry=srf)  # -> Area, Centroid
incurve = PointInCurve(Point=area.Centroid, Curve=graft(core_crv))  # -> Relationship, Point
incurve_2 = PointInCurve(Point=area.Centroid, Curve=graft(opening_crv))  # -> Relationship, Point
addition = Addition(A=incurve_2.Relationship, B=incurve.Relationship)
dispatch = Dispatch(List=srf, DispatchPattern=addition)  # -> ListA, ListB
explode_3 = Explode(Curve=contour_crv, Recursive=True)  # -> Segments, Vertices
boundary_2 = BoundarySurfaces(Edges=core_crv)
panel_2 = Panel("""4
5""")
rfpolyload = RFFreePolygonLoad(LoadPolygon=boundary_2, SurfaceList="1", LoadCase="6", Magnitude1_kN_m²="-5", mode="Assemble")
rfsurfaceload = RFSurfaceLoad(SurfaceList="1", LoadCase="2", Magnitude1_kN_m²="-2.5", mode="Assemble")
rflineload = RFLineLoad(Line=explode_3.Segments, LC="3", F1="-5", mode="Assemble")

# ---- group: Loads / Chessboard Distribution
c_script = CSharpScript(iSurfaces=dispatch.ListB)  # -> out, A; inputs iSurfaces: list of Brep
# ---------- c_script: C# ----------
    var pals = new DataTree<Brep>();
    foreach (Brep sfc in iSurfaces)
    {
      if (!FindPals(sfc, ref pals))
      {
        pals.Add(sfc, new GH_Path(pals.BranchCount));
      }
    }
    A = pals;
# ---------- c_script: C# additional code ----------
  public bool Incompatibility(Brep x, Brep y)
  {
    foreach (BrepEdge edge1 in x.Edges)
    {
      foreach (BrepEdge edge2 in y.Edges)
      {
        var point1 = edge1.PointAtNormalizedLength(0.5);
        var point2 = edge2.PointAtNormalizedLength(0.5);
        if (point1.DistanceTo(point2) < 0.001)
        {
          return true;
        }
      }
    }
    return false;
  }

  public bool FindPals(Brep x, ref DataTree<Brep> pals)
  {
    for (int i = 0; i < pals.BranchCount; i++)
    {
      for(int j = 0;  j < pals.Branches[i].Count; j++)
      {
        if (Incompatibility(x, pals.Branch(i)[j]))
        {
          break;
        }
        if (j == pals.Branches[i].Count - 1)
        {
          pals.Add(x, new GH_Path(i));
          return true;
        }
      }
    }
    return false;
  }
# ---------- end c_script ----------

# ---- group: Loads (continued)
rfpolyload_2 = RFFreePolygonLoad(LoadPolygon=c_script.A, SurfaceList="1", LoadCase=graft(panel_2), Magnitude1_kN_m²="-3.2", mode="Assemble")  # -> flatten(RFFreePolygonLoad)

# ---- group: Set Data in RFEM
# It is possible to define model data, load data
# and load cases and combos within the
# same Set Data Component.
# 
# The export process to RFEM is faster this
# way since the connection between GH and
# RFEM is required only once.
panel_3 = Panel("RFCOM - Loads")
set_data = SetData(
    RunComponent=Button(),
    RFMembers=flatten([rfmember_2, rfmember]),
    RFSurfaces=flatten([rfsurface_2, rfsurface]),
    RFNodalSupports=rfnodalsupport,
    RFLineSupports=rflinesupport,
    RFLineLoads=rflineload,
    RFSurfaceLoads=rfsurfaceload,
    RFFreePolygonLoads=flatten([rfpolyload_2, rfpolyload]),
    RFLoadCases=merge,
    ModelName=panel_3)  # -> RFNodes, RFLines, RFMembers, RFSurfaces, RFOpenings, RFNodalSupports, RFLineSupports, RFLineHinges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

# ==== cluster Cluster
P = ClusterInput()
del = DelaunayMesh(Points=P, Plane=PlaneXY(0, 0, 0))
faceb = FaceBoundaries(Mesh=del)
explode = Explode(Curve=faceb, Recursive=True)  # -> Segments, Vertices
boundary = BoundarySurfaces(Edges=faceb)
len = Length(Curve=explode.Segments)
sort = SortList(Keys=len, ValuesA=explode.Segments)  # -> Keys, reverse(ValuesA)
item = ListItem(List=sort.ValuesA, Index=0, Wrap=True)  # -> flatten(Item)
curvepoint = PointOnCurve(item, parameter=0.5)
null = NullItem(Item=<missing>)  # -> NullFlags, InvalidFlags, Description
cullpt = CullDuplicates(Points=curvepoint, Tolerance=0.1, CullMode=1)  # -> Points, Indices, Valence
x_minus_one = XMinusOne(NumberX=cullpt.Valence)
null_2 = NullItem(Item=<missing>)  # -> NullFlags, InvalidFlags, Description
bool = Boolean(x_minus_one)
sift = SiftPattern(List=boundary, SiftPattern=bool)  # -> Output0, Output1
item_2 = ListItem(List=sift.Output1, Index=cullpt.Indices, Wrap=True)
cull_i = CullIndex(List=sift.Output1, Indices=cullpt.Indices, Wrap=True)
entwine = Entwine(Branch00=sift.Output0, Branch01=item_2, FlattenInputs=True)
cull = CullPattern(List=cull_i, CullPattern=cull_i)
flip = FlipMatrix(Data=entwine)
join = BrepJoin(Breps=flip)  # -> flatten(Breps), Closed
merge = Merge(Data1=join.Breps, Data2=cull)  # -> flatten(Result)
edges = BrepEdges(Brep=merge)  # -> Naked, Interior, NonManifold
boundary_2 = BoundarySurfaces(Edges=edges.Naked)  # -> flatten(Surfaces)
area = Area(Geometry=boundary_2)  # -> Area, Centroid
sort_pt = SortPoints(Points=area.Centroid)  # -> Points, Indices
item_3 = ListItem(List=boundary_2, Index=sort_pt.Indices, Wrap=True)
i = ClusterOutput(item_3)
