# Grasshopper definition 06 RFCOM - Extrude Members.gh (Grasshopper 1.0.7)
# plug-ins: daqRFEM

grasshopper_version = Panel("1.0.0007")
# Plugin Description: This Plug-In enables an interoperability between RFEM and Grasshopper through the RFCOM API.
# 
# It allows the user to import data from RFEM into Grasshopper and also to define new model data through the Grasshopper interface.
plugin = Panel("RFEM")
# B+G Team: B+G Ingenieure Bollinger und Grohmann GmbH
# Alt-Moabit 103  / D-10559 Berlin  / Tel. +49 30 - 41 95 369 0  / Fax +49 30 - 41 95 369 99
# Diego Apellániz
# dapellaniz@bollinger-grohmann.de
related_rfem_file_s = Panel("05 RFCOM - Loads.rf5")
# Description: It is indeed possible to import cross section shapes into Grasshopper in order to extrude members into 3D objects.
# 
# Some key aspects to take into account:
# 
# - Have a look into the member types of your structure first. Some member types such as "Rigid", "Tension", etc. don´t provide information of assigned cross sections.
# 
# - Note that some cross sections are made up of more than one curve!
# 
# - Member local axis will be imported as perpendicular frames at the start and end of member base lines.
# 
# - Cross sections will be imported into O(0,0,0). It´s necessary to align their local axis with the member local axis.
additional_plugins = Panel("")
# Only Beam members will be imported.
# Some member types such as Rigid,
# Tension, etc. don´t provide information of
# assigned cross sections.
panel = Panel("Beam")
filter_data = FilterData(MemberType=panel, mode="Members")
toggle = BooleanToggle(True)
get_data = GetData(RunComponent=Button(), Members=toggle, CrossSections=toggle, Filter=filter_data, ModelName="RFCOM - Extrude Members")  # -> RFNodes, RFLines, RFMembers, RFSurfaces, RFOpenings, RFNodalSupports, RFLineSupports, RFLineHinges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
rfmember = RFMember(RFMember=get_data.RFMembers, mode="Disassemble")  # -> Line, MemberNumber, Comment, LineNumber, MemberType, RotationAngle_, RotationType, StartCrossSection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
# It is possible to import all kinds of cross
# section shapes into Grasshooper.
# 
# Note that some cross sections are made up
# of more than one curve!
rfcrosec = RFCrossSection(RFCrossSection=get_data.RFCrossSections, mode="Disassemble")  # -> Description, CrossSectionNumber, Comment, MaterialNumber, AxialArea_m², ShearAreaY_m², ShearAreaZ_m², BendingMomentY_m⁴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
# Member local axis will be imported as
# perpendicular frames at the start and
# end of member base lines.
item = ListItem(List=rfmember.LocalAxis, Index=0, Wrap=True)
mindex = MemberIndex(Set=rfcrosec.CrossSectionNumber, Member=rfmember.StartCrossSection)  # -> flatten(Index), Count
viewer = ParamViewer(rfcrosec.SectionShape)
item_2 = ListItem(List=viewer, Index=mindex.Index, Wrap=True)
Y = UnitY(Factor="-1")
branch = TreeBranch(Tree=rfcrosec.SectionShape, Path=item_2, MaintainPaths=False)
pl = ConstructPlane(Origin=Point(0, 0, 0), XAxis=Vector(1, 0, 0), YAxis=Y)
# Cross sections will be imported into O(0,0,0).
# It´s necessary to align their local axis with
# the member local axis.
orient = Orient(Geometry=branch, Source=pl, Target=item)  # -> Geometry, Transform
extrcrv = ExtrudeAlong(Base=orient.Geometry, Curve=graft(rfmember.Line))
